# Dynamo graph 01_PP_Floor_ByRoom.dyn (Dynamo 2.19.3.6394)
# packages: Data-Shapes 2021.2.91, Clockwork for Dynamo 2.x 2.6.0, Genius Loci 2024.5.29, Rhythm 2024.3.1, archi-lab.net 2024.217.1024

# group: Get_Placed_Rooms
categories = Categories("OST_Rooms")
all_elements_of_category = ElementsOfCategory(Category=categories)
room_status = Custom[Room Status](Rooms=all_elements_of_category)  # package Data-Shapes; Sorts a list of room into three categories: unplaced, PlacedAndBounded and unbounded

# group: Get_Rooms_With_FloorFinish_Value
parameters = Element.Parameters(element=room_status.PlacedAndBounded)
name = Parameter.Name(parameter=parameters)
code_block = CodeBlock { "Floor Finish"; }
eq = name == code_block
filterByBoolMask = List.FilterByBoolMask(list=parameters, mask=eq)
hasValue = Parameter.HasValue(parameter=filterByBoolMask.in)
flatten = List.Flatten(list=hasValue)
filterByBoolMask_2 = List.FilterByBoolMask(list=room_status.PlacedAndBounded, mask=flatten)
getParameterValueByName = Element.GetParameterValueByName(element=filterByBoolMask_2.in, parameterName=code_block)

# group: Get_All_Floor_Types
categories_2 = Categories("OST_Floors")
all_family_types_of_category = Custom[All Family Types Of Category](category=categories_2)  # package Clockwork for Dynamo 2.x; Gets all family types/symbols of a given category in the model.
code_block_2 = CodeBlock { "RD_Element_Tag"; "equals"; "Floor Finish"; }

# group: Get_Parameter_For_NonJoined_Floors_Creation
finishBoundary = Room.FinishBoundary(room=filterByBoolMask_2.in)
byJoinedCurves = PolyCurve.ByJoinedCurves(curves=finishBoundary)
ʳʰʸᵗʰᵐ_elementfilter = Rhythm.Revit.ElementFilter.ElementFilter.ByParameterStringValue(elements=all_family_types_of_category, parameterName=code_block_2.out0, value=getParameterValueByName, filterMethod=code_block_2.out1)
element_level = Custom[Element Level](element=filterByBoolMask_2.in)  # package Genius Loci; Gets an element's level. Based on a Clockwork's node

# group: Create_Singular_Floors
byOutlineTypeAndLevel = Floor.ByOutlineTypeAndLevel(outline=byJoinedCurves, floorType=ʳʰʸᵗʰᵐ_elementfilter, level=element_level)

# group: Get_Floors_Geometry
flatten_2 = List.Flatten(list=byOutlineTypeAndLevel)
geometry = Element.Geometry(element=flatten_2)

# group: Get_Room_Separators
categories_3 = Categories("OST_RoomSeparationLines")
all_elements_of_category_2 = ElementsOfCategory(Category=categories_3)
geometry_2 = Element.Geometry(element=all_elements_of_category_2)
flatten_3 = List.Flatten(list=geometry_2)
startPoint = Curve.StartPoint(curve=flatten_3)
tangentAtParameter = Curve.TangentAtParameter(curve=flatten_3)
byCenterPointRadiusNormal = Circle.ByCenterPointRadiusNormal(centerPoint=startPoint, normal=tangentAtParameter)
bySweep = Solid.BySweep(profile=byCenterPointRadiusNormal, path=flatten_3)

# group: Check_Floor&Separator_ Intersections
doesIntersect = Geometry.DoesIntersect(geometry=geometry, other=bySweep, lacing=CrossProduct)
boolean = BoolSelector(true)
contains = List.Contains(list=doesIntersect, item=boolean, lacing=CrossProduct)

# group: Group_Joined_Floors_By_FloorType
filterByBoolMask_3 = List.FilterByBoolMask(list=flatten_2, mask=contains)
type = archilab.Revit.Elements.Elements.Type(element=filterByBoolMask_3.in)
groupByKey = List.GroupByKey(list=filterByBoolMask_3.in, keys=type)
element_level_2 = Custom[Element Level](element=filterByBoolMask_3.in)

# group: Join_Floor_Geometry
geometry_3 = Element.Geometry(element=groupByKey.groups)
byUnion = Solid.ByUnion(solids=geometry_3)
byUnion_2 = Solid.ByUnion(solids=byUnion)
XY = Plane.XY()
intersect = Geometry.Intersect(geometry=byUnion_2, other=XY)
perimeterCurves = Surface.PerimeterCurves(surface=intersect)

# group: Create_Joined_Floors
byJoinedCurves_2 = PolyCurve.ByJoinedCurves(curves=perimeterCurves)
byOutlineTypeAndLevel_2 = Floor.ByOutlineTypeAndLevel(outline=byJoinedCurves_2, floorType=type, level=element_level_2)

# group: Delete_Redundant_Elements
passThrough = Custom[PassThrough](passThrough=groupByKey.groups, waitFor=perimeterCurves)  # package archi-lab.net; Ripped this off from Clockwork. Sorry Andy.
flatten_4 = List.Flatten(list=passThrough)
delete = Element.Delete(element=flatten_4)
