# Dynamo graph 02_PP_Ceiling_ByType_ByRoom.dyn "02_PP_Ceiling_ByType__ByRoom" (Dynamo 2.19.3.6394)
# packages: Genius Loci 2024.5.29, Data-Shapes 2021.2.91, Clockwork for Dynamo 2.x 2.6.0, Rhythm 2024.3.1, archi-lab.net 2024.217.1024

# group: Get_Placed_Rooms
categories = Categories("OST_Rooms")
all_elements_of_category = ElementsOfCategory(Category=categories)
room_status = Custom[Room Status](Rooms=all_elements_of_category)  # package Data-Shapes; Sorts a list of room into three categories: unplaced, PlacedAndBounded and unbounded

# group: Get_Rooms_With_CeilingFinish_Value
parameters = Element.Parameters(element=room_status.PlacedAndBounded)
name = Parameter.Name(parameter=parameters)
code_block = CodeBlock { "Ceiling Finish"; }
eq = name == code_block
filterByBoolMask = List.FilterByBoolMask(list=parameters, mask=eq)
hasValue = Parameter.HasValue(parameter=filterByBoolMask.in)
flatten = List.Flatten(list=hasValue)
filterByBoolMask_2 = List.FilterByBoolMask(list=room_status.PlacedAndBounded, mask=flatten)
getParameterValueByName = Element.GetParameterValueByName(element=filterByBoolMask_2.in, parameterName=code_block)

# group: Get_All_Ceiling_Types
categories_2 = Categories("OST_Ceilings")
all_family_types_of_category = Custom[All Family Types Of Category](category=categories_2)  # package Clockwork for Dynamo 2.x; Gets all family types/symbols of a given category in the model.
code_block_2 = CodeBlock { "RD_Element_Tag"; "equals"; "_"; }

# group: Extract_CeilingType_Tag
split = String.Split(string=getParameterValueByName, separator0=code_block_2.out2)
firstItem = List.FirstItem(list=split, lacing=CrossProduct)

# group: Get_Parameter_For_NonJoined_Ceiling_Creation
finishBoundary = Room.FinishBoundary(room=filterByBoolMask_2.in)
ʳʰʸᵗʰᵐ_elementfilter = Rhythm.Revit.ElementFilter.ElementFilter.ByParameterStringValue(elements=all_family_types_of_category, parameterName=code_block_2.out0, value=firstItem, filterMethod=code_block_2.out1)
element_level = Custom[Element Level](element=filterByBoolMask_2.in)  # package Genius Loci; Gets an element's level. Based on a Clockwork's node

# group: Create_Singular_Ceilings
byOutlineTypeAndLevel = Ceiling.ByOutlineTypeAndLevel(outlineCurves=finishBoundary, ceilingType=ʳʰʸᵗʰᵐ_elementfilter, level=element_level)

# group: Set_Ceiling_Height_Temporarly_To_5
flatten_2 = List.Flatten(list=byOutlineTypeAndLevel)
code_block_3 = CodeBlock { "Height Offset From Level"; }
code_block_4 = CodeBlock { "5"; }
toNumber = String.ToNumber(string=code_block_4)
setParameterByName = Element.SetParameterByName(element=flatten_2, parameterName=code_block_3, value=toNumber)

# group: Get_Celings_Geometry
flatten_3 = List.Flatten(list=setParameterByName)
geometry = Element.Geometry(element=flatten_3)

# group: Get_Room_Separators
categories_3 = Categories("OST_RoomSeparationLines")
all_elements_of_category_2 = ElementsOfCategory(Category=categories_3)
geometry_2 = Element.Geometry(element=all_elements_of_category_2)
flatten_4 = List.Flatten(list=geometry_2)
startPoint = Curve.StartPoint(curve=flatten_4)
code_block_5 = CodeBlock { 10; }
tangentAtParameter = Curve.TangentAtParameter(curve=flatten_4)
byCenterPointRadiusNormal = Circle.ByCenterPointRadiusNormal(centerPoint=startPoint, radius=code_block_5, normal=tangentAtParameter)
bySweep = Solid.BySweep(profile=byCenterPointRadiusNormal, path=flatten_4)

# group: Check_Ceiling&Separator_ Intersections
doesIntersect = Geometry.DoesIntersect(geometry=geometry, other=bySweep, lacing=CrossProduct)
boolean = BoolSelector(true)
contains = List.Contains(list=doesIntersect, item=boolean, lacing=CrossProduct)

# group: Group_Joined_Ceilings_By_CeilingType
filterByBoolMask_3 = List.FilterByBoolMask(list=flatten_3, mask=contains)
type = archilab.Revit.Elements.Elements.Type(element=filterByBoolMask_3.in)
groupByKey = List.GroupByKey(list=filterByBoolMask_3.in, keys=type)
element_level_2 = Custom[Element Level](element=filterByBoolMask_3.in)

# group: Join_Ceiling_Geometry
geometry_3 = Element.Geometry(element=groupByKey.groups)
byUnion = Solid.ByUnion(solids=geometry_3)
byUnion_2 = Solid.ByUnion(solids=byUnion)
XY = Plane.XY()
code_block_6 = CodeBlock { 5; }
translate = Geometry.Translate(geometry=XY, zTranslation=code_block_6)
intersect = Geometry.Intersect(geometry=byUnion_2, other=translate)
perimeterCurves = Surface.PerimeterCurves(surface=intersect)

# group: Delete_Redundant_Elements
passThrough = Custom[PassThrough](passThrough=groupByKey.groups, waitFor=perimeterCurves)  # package archi-lab.net; Ripped this off from Clockwork. Sorry Andy.
flatten_5 = List.Flatten(list=passThrough)
delete = Element.Delete(element=flatten_5)

# group: Create_Joined_Ceilings
byJoinedCurves = PolyCurve.ByJoinedCurves(curves=perimeterCurves)
byOutlineTypeAndLevel_2 = Ceiling.ByOutlineTypeAndLevel(outline=byJoinedCurves, ceilingType=type, level=element_level_2)

# group: List_Created_Ceilings
list_create = List.Create()  # unwired: item0, item1
flatten_6 = List.Flatten(list=byOutlineTypeAndLevel_2)
combine = List.Combine(combineFunction=list_create, list0=flatten_6, list1=filterByBoolMask_3.out)

# group: Get_Ceiling_Associated_Room
flatten_7 = List.Flatten(list=combine)
geometry_4 = Element.Geometry(element=flatten_7)
flatten_8 = List.Flatten(list=filterByBoolMask_2.in)
geometry_5 = Element.Geometry(element=flatten_8)
doesIntersect_2 = Geometry.DoesIntersect(geometry=geometry_4, other=geometry_5, lacing=CrossProduct)
boolean_2 = BoolSelector(true)
contains_2 = List.Contains(list=doesIntersect_2, item=boolean_2, lacing=CrossProduct)
filterByBoolMask_4 = List.FilterByBoolMask(list=filterByBoolMask_2.in, mask=contains_2)

# group: Extract_Celiling_Height
code_block_7 = CodeBlock { "Ceiling Finish"; "_"; }
getParameterValueByName_2 = Element.GetParameterValueByName(element=filterByBoolMask_4.in, parameterName=code_block_7.out0)
split_2 = String.Split(string=getParameterValueByName_2, separator0=code_block_7.out1)
lastItem = List.LastItem(list=split_2, lacing=CrossProduct)

# group: Set_Ceiling_Height
flatten_9 = List.Flatten(list=flatten_7)
passThrough_2 = Custom[PassThrough](passThrough=flatten_9, waitFor=lastItem)
code_block_8 = CodeBlock { "Height Offset From Level"; }
toNumber_2 = String.ToNumber(string=lastItem)
setParameterByName_2 = Element.SetParameterByName(element=passThrough_2, parameterName=code_block_8, value=toNumber_2)
